# Dynamo graph script.dyn "BM_CreaNivelesDesdeExcel_UI" (Dynamo 2.12.1.8246)
# author: Felipe Bonnemaison
# Crea niveles a partir de un listado de excel.
# packages: Data-Shapes 2023.2.111

# group: Créditos
# note: CREADO POR:
# Felipe Bonnemaison
# VERSION 2.0 (UI)
# 2025.02.14
# DYNAMO:
# Dynamo 2.12
# Iron Python 2.7
# PACKAGES:
# Data-Shapes

# group: UI: Notas
code_block = CodeBlock { "Notas"; "Crea niveles a partir de un listado de excel. Revisar unidades de Origen-Destino."; }
# note: Data-Shapes
textnote_data = Custom[TextNote Data](Title=code_block.out0, TextNote=code_block.out1)  # package Data-Shapes; Create Data for TextNote input in UI.MultipleInputForm ++ . Check out www.data-shapes.net for more informations

# group: UI: Selección Archivo Excel
code_block_2 = CodeBlock { "Selección de Archivo"; "Archivo Excel"; }
file_path = Filename("..\..\..\..\..\..\..\..\Data\BM_CreaNivelesDesdeExcel_UI.xlsx")
# note: Data-Shapes
filepath_data = Custom[FilePath Data](InputName=code_block_2.out0, DefaulPath=file_path, ButtonText=code_block_2.out1)  # package Data-Shapes; Create filepath input for UI.MultipleInputForm ++ . Check out www.data-shapes.net for more infos !

# group: UI: Selección Pestaña Excel
code_block_3 = CodeBlock { "Indicar que pestaña de excel leer"; "Hoja1"; }
# note: Data-Shapes
textbox_data = Custom[TextBox Data](InputName=code_block_3.out0, DefaultText=code_block_3.out1)  # package Data-Shapes; Create Data for TextBox input in UI.MultipleInputForm ++ . Check out www.data-shapes.net for more informations

# group: CREA UI
code_block_4 = CodeBlock { "CREA NIVELES DESDE EXCEL"; "Ejecutar"; "Cancelar"; 600; 250; }
file_path_2 = Filename("..\..\..\..\..\..\..\..\Logo\logo.png")
file_from_path = FileObject(path=file_path_2)
readFromFile = Image.ReadFromFile(file=file_from_path)
list_create = List.Create(item0=textnote_data, item1=filepath_data, item2=textbox_data)
boolean = BoolSelector(true)
# note: Data-Shapes
multipleinputform = Custom[MultipleInputForm ++](Description_optional=code_block_4.out0, Logo_optional=readFromFile, ButtonText_optional=code_block_4.out1, Inputs=list_create, Toggle=boolean, CancelButtonText_optional=code_block_4.out2, Width_optional=code_block_4.out3, LabelWidth_optional=code_block_4.out4)  # package Data-Shapes; Create a form with multiple inputs. see www.data-shapes.net for tutorials and infos!

# group: FILTRAR DATA
code_block_5 = CodeBlock { 0; 1; }
archivo_excel = List.GetItemAtIndex(list=multipleinputform.User_Inputs, index=code_block_5.out0)
pestaña_excel = List.GetItemAtIndex(list=multipleinputform.User_Inputs, index=code_block_5.out1)

# group: IMPORTA DATA DESDE EXCEL
code_block_6 = CodeBlock { 1; 0; }
boolean_2 = BoolSelector(false)
openXMLImportExcel = Data.OpenXMLImportExcel(filePath=archivo_excel, sheetName=pestaña_excel, startRow=code_block_6.out0, startColumn=code_block_6.out1, readAsString=boolean_2)
transpose = List.Transpose(lists=openXMLImportExcel)
code_block_7 = CodeBlock { 0; }
getItemAtIndex = List.GetItemAtIndex(list=transpose, index=code_block_7)
code_block_8 = CodeBlock { 1; }
getItemAtIndex_2 = List.GetItemAtIndex(list=transpose, index=code_block_8)

byElevationAndName = Level.ByElevationAndName(elevation=getItemAtIndex, name=getItemAtIndex_2)
byLevel = FloorPlanView.ByLevel(level=byElevationAndName)
