# Dynamo graph script.dyn "BM_CreaLaminasDesdeExcel_UI" (Dynamo 2.12.1.8246)
# author: Felipe Bonnemaison
# Crea láminas desde un listado de excel
# packages: Data-Shapes 2023.2.111, Clockwork for Dynamo 2.x 2.6.0

# group: Créditos
# note: CREADO POR:
# Felipe Bonnemaison
# VERSION 2.0 (UI)
# 2025.02.14
# DYNAMO:
# Dynamo 2.12
# Iron Python 2.7
# PACKAGES:
# Data-Shapes
# Clockwork

# group: UI: Notas
code_block = CodeBlock { "Notas"; "Crea laminas a partir de listado de excel."; }
# note: Data-Shapes
textnote_data = Custom[TextNote Data](Title=code_block.out0, TextNote=code_block.out1)  # package Data-Shapes; Create Data for TextNote input in UI.MultipleInputForm ++ . Check out www.data-shapes.net for more informations

# group: UI: Selección Archivo Excel
code_block_2 = CodeBlock { "Selección de Archivo"; "Archivo Excel"; }
file_path = Filename("..\..\..\..\..\..\..\..\Data\BM_CreaLaminasDesdeExcel_UI.xlsx")
# note: Data-Shapes
filepath_data = Custom[FilePath Data](InputName=code_block_2.out0, DefaulPath=file_path, ButtonText=code_block_2.out1)  # package Data-Shapes; Create filepath input for UI.MultipleInputForm ++ . Check out www.data-shapes.net for more infos !

# group: UI: Selección Pestaña Excel
code_block_3 = CodeBlock { "Indicar que pestaña de excel leer"; "Hoja1"; }
# note: Data-Shapes
textbox_data = Custom[TextBox Data](InputName=code_block_3.out0, DefaultText=code_block_3.out1)  # package Data-Shapes; Create Data for TextBox input in UI.MultipleInputForm ++ . Check out www.data-shapes.net for more informations

# group: UI: Selección Lamina (Title Block)
code_block_4 = CodeBlock { "Seleccionar Formato (Tttle Block)"; 0; }
categories = Categories("OST_TitleBlocks")

# note: Clockwork
all_family_types_of_category = Custom[All Family Types Of Category](category=categories)  # package Clockwork for Dynamo 2.x; Gets all family types/symbols of a given category in the model.

# group (continued): UI: Selección Lamina (Title Block)
name = FamilyType.Name(familyType=all_family_types_of_category)
# note: Data-Shapes
dropdown_data = Custom[DropDown Data](InputName=code_block_4.out0, Keys=name, Values=all_family_types_of_category, DefaultValueIndex=code_block_4.out1)  # package Data-Shapes; Create data for DropDown input in UI.MultiInputForm ++ . Check out www.data-shapes.net for more infos.

# group: CREA UI
code_block_5 = CodeBlock { "CREA LAMINAS DESDE EXCEL"; "Ejecutar"; "Cancelar"; 600; 250; }
file_path_2 = Filename("..\..\..\..\..\..\..\..\Logo\logo.png")
file_from_path = FileObject(path=file_path_2)
readFromFile = Image.ReadFromFile(file=file_from_path)
list_create = List.Create(item0=textnote_data, item1=filepath_data, item2=textbox_data, item3=dropdown_data)
boolean = BoolSelector(true)
# note: Data-Shapes
multipleinputform = Custom[MultipleInputForm ++](Description_optional=code_block_5.out0, Logo_optional=readFromFile, ButtonText_optional=code_block_5.out1, Inputs=list_create, Toggle=boolean, CancelButtonText_optional=code_block_5.out2, Width_optional=code_block_5.out3, LabelWidth_optional=code_block_5.out4)  # package Data-Shapes; Create a form with multiple inputs. see www.data-shapes.net for tutorials and infos!

# group: FILTRAR DATA
code_block_6 = CodeBlock { 0; 1; 2; }
archivo_excel = List.GetItemAtIndex(list=multipleinputform.User_Inputs, index=code_block_6.out0)
pestaña_excel = List.GetItemAtIndex(list=multipleinputform.User_Inputs, index=code_block_6.out1)
familia_lamina = List.GetItemAtIndex(list=multipleinputform.User_Inputs, index=code_block_6.out2)

# group: IMPORTA DATA DESDE EXCEL
code_block_7 = CodeBlock { 1; }
boolean_2 = BoolSelector(true)
openXMLImportExcel = Data.OpenXMLImportExcel(filePath=archivo_excel, sheetName=pestaña_excel, startRow=code_block_7, readAsString=boolean_2)
transpose = List.Transpose(lists=openXMLImportExcel)
code_block_8 = CodeBlock { 1; }
getItemAtIndex = List.GetItemAtIndex(list=transpose, index=code_block_8)
code_block_9 = CodeBlock { 0; }
getItemAtIndex_2 = List.GetItemAtIndex(list=transpose, index=code_block_9)

byNameNumberTitleBlock = Sheet.ByNameNumberTitleBlock(sheetName=getItemAtIndex, sheetNumber=getItemAtIndex_2, titleBlockFamilyType=familia_lamina)
