# Dynamo graph script.dyn "BM_CreaKeyScheduleDesdeExcel_UI" (Dynamo 2.12.1.8246)
# author: Felipe Bonnemaison
# Importa data a Key Schedule
# packages: Data-Shapes 2023.2.111, archi-lab.net 2022.210.1022

# group: Créditos
# note: CREADO POR:
# Felipe Bonnemaison
# VERSION 2.0 (UI)
# 2025.02.12
# DYNAMO:
# Dynamo 2.12
# Iron Python 2.7
# PACKAGES:
# Data-Shapes
# archi-lab.net

# group: UI: Notas
code_block = CodeBlock { "Notas"; "El Key Schedule debe estar creado, por defecto se rellenan los campos 'Key Name' y 'Comments'."; }
# note: Data-Shapes
textnote_data = Custom[TextNote Data](Title=code_block.out0, TextNote=code_block.out1)  # package Data-Shapes; Create Data for TextNote input in UI.MultipleInputForm ++ . Check out www.data-shapes.net for more informations

# group: UI: Selección Archivo Excel
code_block_2 = CodeBlock { "Selección de Archivo"; "Archivo Excel"; }
file_path = Filename("..\..\..\..\..\..\..\..\Data\BM_CreaKeyScheduleDesdeExcel_UI.xlsx")
# note: Data-Shapes
filepath_data = Custom[FilePath Data](InputName=code_block_2.out0, DefaulPath=file_path, ButtonText=code_block_2.out1)  # package Data-Shapes; Create filepath input for UI.MultipleInputForm ++ . Check out www.data-shapes.net for more infos !

# group: UI: Selección Pestaña Excel
code_block_3 = CodeBlock { "Indicar que pestaña de excel leer"; "OGUC"; }
# note: Data-Shapes
textbox_data = Custom[TextBox Data](InputName=code_block_3.out0, DefaultText=code_block_3.out1)  # package Data-Shapes; Create Data for TextBox input in UI.MultipleInputForm ++ . Check out www.data-shapes.net for more informations

# group: UI: Selección Vistas de Key Schedules
# note: NOTA: Se debe seleccionar una vista de "Key Schedule"
code_block_4 = CodeBlock { "Seleccionar Key Schedule"; 0; }
element_types = ElementTypes("ViewSchedule")
all_elements_of_type = ElementsOfType(element_type=element_types)
name = FamilyType.Name(familyType=all_elements_of_type)
# note: Data-Shapes
dropdown_data = Custom[DropDown Data](InputName=code_block_4.out0, Keys=name, Values=all_elements_of_type, DefaultValueIndex=code_block_4.out1)  # package Data-Shapes; Create data for DropDown input in UI.MultiInputForm ++ . Check out www.data-shapes.net for more infos.

# group: CREA UI
code_block_5 = CodeBlock { "KEY SCHEDULE DESDE EXCEL"; "Ejecutar"; "Cancelar"; 600; 200; }
file_path_2 = Filename("..\..\..\..\..\..\..\..\Logo\logo.png")
file_from_path = FileObject(path=file_path_2)
readFromFile = Image.ReadFromFile(file=file_from_path)
list_create = List.Create(item0=textnote_data, item1=filepath_data, item2=textbox_data, item3=dropdown_data)
boolean = BoolSelector(true)
# note: Data-Shapes
multipleinputform = Custom[MultipleInputForm ++](Description_optional=code_block_5.out0, Logo_optional=readFromFile, ButtonText_optional=code_block_5.out1, Inputs=list_create, Toggle=boolean, CancelButtonText_optional=code_block_5.out2, Width_optional=code_block_5.out3, LabelWidth_optional=code_block_5.out4)  # package Data-Shapes; Create a form with multiple inputs. see www.data-shapes.net for tutorials and infos!

# group: FILTRAR DATA
code_block_6 = CodeBlock { 0; 1; 2; }
key_schedule = List.GetItemAtIndex(list=multipleinputform.User_Inputs, index=code_block_6.out2)
archivo_excel = List.GetItemAtIndex(list=multipleinputform.User_Inputs, index=code_block_6.out0)
pestaña_excel = List.GetItemAtIndex(list=multipleinputform.User_Inputs, index=code_block_6.out1)

# group: COMPLETA DATOS KEY SCHEDULE
openXMLImportExcel = Data.OpenXMLImportExcel(filePath=archivo_excel, sheetName=pestaña_excel)
restOfItems = List.RestOfItems(list=openXMLImportExcel)
code_block_7 = CodeBlock { ["Key Name", "Comments"]; }
boolean_2 = BoolSelector(true)
# note: archilab
key_schedule_2 = Custom[Key Schedule](viewSchedule=key_schedule, data=restOfItems, parameterNames=code_block_7, upperCase=boolean_2)  # package archi-lab.net; This node will take a key schedule, data and a list of parameters and populate it with infomation from data parameter. Visit www.archi-lab.net for more information on how to prep this node for take off.
