# Dynamo graph script.dyn (Dynamo 2.12.1.8246)
# author: Felipe Bonnemaison
# Nota: Las láminas a exportar deben estar asignadas a Sets (Publish Settings)
# packages: Data-Shapes 2023.2.111, Genius Loci 2022.3.28, archi-lab.net 2022.210.1022

# group: Créditos
# note: CREADO POR:
# Felipe Bonnemaison
# VERSION 3.0 (UI)
# 2025.02.12
# DYNAMO:
# Dynamo 2.12
# Iron Python 2.7
# PACKAGES:
# Data-Shapes 2023.2.111
# Genius Loci 2022.3.28
# Archi-lab.net 2022.210.1022

# group: UI: Notas
code_block = CodeBlock { "Notas"; "Esta rutina exportará láminas en formato DWG y PDF. La codificación será 'CódigoMandante_Revisión'"; }
# note: Data-Shapes
textnote_data = Custom[TextNote Data](Title=code_block.out0, TextNote=code_block.out1)  # package Data-Shapes

# group: 1. Selección de Set de Láminas
element_classes = ElementTypes("ViewSheetSet")
all_elements_of_class = ElementsOfType(element_class=element_classes)

# group: UI: Selección Láminas
code_block_2 = CodeBlock { "Selección de Láminas (SET)"; 0; }
name = FamilyType.Name(familyType=all_elements_of_class)
# note: Data-Shapes
dropdown_data = Custom[DropDown Data](InputName=code_block_2.out0, Keys=name, Values=all_elements_of_class, DefaultValueIndex=code_block_2.out1)  # package Data-Shapes

# group: 2. Ruta
directory_path = Directory("C:\Export")

# group: UI: Selección Ruta
code_block_3 = CodeBlock { "Selección de Ruta"; "Ruta"; }
# note: Data-Shapes
directorypath_data = Custom[DirectoryPath Data](InputName=code_block_3.out0, DefaultPath=directory_path, ButtonText=code_block_3.out1)  # package Data-Shapes

# group: 3. Selección Configuracción Exportación DWG
element_classes_2 = ElementTypes("ExportDWGSettings")
all_elements_of_class_2 = ElementsOfType(element_type=element_classes_2)

# group: UI: Configuración Exportación DWG
code_block_4 = CodeBlock { "Configuración Exportación (DWG)"; 0; }
name_2 = FamilyType.Name(familyType=all_elements_of_class_2)
# note: Data-Shapes
dropdown_data_2 = Custom[DropDown Data](InputName=code_block_4.out0, Keys=name_2, Values=all_elements_of_class_2, DefaultValueIndex=code_block_4.out1)

# group: CREA UI
code_block_5 = CodeBlock { "EXPORTAR DWG y PDF"; "Ejecutar"; "Cancelar"; 600; 250; }
file_path = Filename("..\..\..\..\..\..\..\Logo\logo.png")
file_from_path = FileObject(path=file_path)
readFromFile = Image.ReadFromFile(file=file_from_path)
list_create = List.Create(item0=textnote_data, item1=dropdown_data, item2=directorypath_data, item3=dropdown_data_2)
boolean = BoolSelector(true)
# note: Data-Shapes
multipleinputform = Custom[MultipleInputForm ++](Description_optional=code_block_5.out0, Logo_optional=readFromFile, ButtonText_optional=code_block_5.out1, Inputs=list_create, Toggle=boolean, CancelButtonText_optional=code_block_5.out2, Width_optional=code_block_5.out3, LabelWidth_optional=code_block_5.out4)  # package Data-Shapes

# group: FILTRAR DATA
code_block_6 = CodeBlock { 0; 1; 2; }
ruta = List.GetItemAtIndex(list=multipleinputform.User_Inputs, index=code_block_6.out1)
láminas = List.GetItemAtIndex(list=multipleinputform.User_Inputs, index=code_block_6.out0)
# note: ArchiLab
get_views_from_view_set = Custom[Get Views from View Set](viewSet=láminas)  # package archi-lab.net; This node will take a name of a view set and return views/sheet elements contained in it.
codificación = List.GetItemAtIndex(list=multipleinputform.User_Inputs, index=code_block_6.out2)
configuración_de_exportación_dwg = Element.Name(element=codificación)  # graph output

# group: Parámetros Codificación Láminas
code_block_7 = CodeBlock { "COD_CLIENTE"; "Current Revision"; }
list_create_2 = List.Create(item0=code_block_7.out0, item1=code_block_7.out1)

# group: Lista Láminas Codificadas
getParameterValueByName = Element.GetParameterValueByName(element=get_views_from_view_set@L1, parameterName=list_create_2)
code_block_8 = CodeBlock { "_"; 1; }
insert = List.Insert(list=getParameterValueByName@L2, element=code_block_8.out0, index=code_block_8.out1, lacing=CrossProduct)
concat = String.Concat(string0=insert)
láminas_en_el_set = List.Flatten(list=concat)  # graph output

# group: Exportar PDF
combinar_pdf_s = BoolSelector(false)
# note: GeniusLoci
exportPDF = Custom[ExportPDF](DirectoryPath=ruta, view=get_views_from_view_set, Filename=láminas_en_el_set, Combine=combinar_pdf_s)  # package Genius Loci; Works only in Revit 2022 and later. Exports a selection of views in PDF format.
watch = Watch(exportPDF)

# group: Exportar DWG
boolean_2 = BoolSelector(true)
# note: GeniusLoci
export_dwg_in_document = Custom[Export DWG in Document](DirectoryPath=ruta, view=get_views_from_view_set, Filename=láminas_en_el_set, ExportSetup=configuración_de_exportación_dwg, SharedCoords=boolean_2, MergeViews=boolean_2, RunIt=boolean_2)  # package Genius Loci; Export views to DWG with export setup in the active or given document. Based on a script by Konrad K Sobon.
watch_2 = Watch(export_dwg_in_document)
