# Dynamo graph script.dyn (Dynamo 2.12.1.8246)
# author: Felipe Bonnemaison
# Reemplaza Starting View y Parametros
# packages: Clockwork for Dynamo 2.x 2.6.0, Genius Loci 2022.3.28, Data-Shapes 2023.2.111

# group: Créditos
# note: CREADO POR:
# Felipe Bonnemaison
# VERSION 2.0 (UI)
# 2025.02.04
# DYNAMO:
# Dynamo 2.12
# Iron Python 2.7
# PACKAGES:
# Data-Shapes
# Genius Loci
# Clockwork

# group: UI: Notas
code_block = CodeBlock()
# ---------- code_block.designscript (2 lines) ----------
"Notas";
"Esta rutina reemplazará el Starting View y asignará parámetros faltantes (Si la familia tiene el mismo nombre en el origen y destino, no se reemplazará)";
# ----------------------------------------
# note: Data-Shapes
textnote_data = Custom[TextNote Data](Title=code_block.out0, TextNote=code_block.out1)  # package Data-Shapes; Create Data for TextNote input in UI.MultipleInputForm ++ . Check out www.data-shapes.net for more informations

# group: UI: Selección Nueva Familia Starting View
code_block_2 = CodeBlock { "Selección de Archivo"; "Archivo RFA"; }
file_path = Filename("..\..\..\..\..\..\..\..\Data\GA_Formato Starting View A1-R22-N.rfa")
# note: Data-Shapes
filepath_data = Custom[FilePath Data](InputName=code_block_2.out0, DefaulPath=file_path, ButtonText=code_block_2.out1)  # package Data-Shapes; Create filepath input for UI.MultipleInputForm ++ . Check out www.data-shapes.net for more infos !

# group: UI: Parámetros Faltantes
code_block_3 = CodeBlock { "Drawn By"; "NN"; }
# note: Data-Shapes
textbox_data = Custom[TextBox Data](InputName=code_block_3.out0, DefaultText=code_block_3.out1)  # package Data-Shapes; Create Data for TextBox input in UI.MultipleInputForm ++ . Check out www.data-shapes.net for more informations
code_block_4 = CodeBlock { "Designed By"; "NN"; }
textbox_data_2 = Custom[TextBox Data](InputName=code_block_4.out0, DefaultText=code_block_4.out1)
code_block_5 = CodeBlock { "Checked By"; "NN"; }
textbox_data_3 = Custom[TextBox Data](InputName=code_block_5.out0, DefaultText=code_block_5.out1)
code_block_6 = CodeBlock { "Approved By"; "NN"; }
textbox_data_4 = Custom[TextBox Data](InputName=code_block_6.out0, DefaultText=code_block_6.out1)

# group: CREA UI
code_block_7 = CodeBlock { "REEMPLAZA STARTING VIEW"; "Ejecutar"; "Cancelar"; 600; 200; }
file_path_2 = Filename("..\..\..\..\..\..\..\..\..\ARCADIS\Especialidad OOCC y Estructuras - 02 Comun\Biblioteca BIM Estructuras\05 Toolbar Revit\EyAtoolBar.extension\EyAtoolBar.tab\About.panel\about.pushbutton\logo.png")
file_from_path = FileObject(path=file_path_2)
readFromFile = Image.ReadFromFile(file=file_from_path)
list_create = List.Create(item0=textnote_data, item1=filepath_data, item2=textbox_data, item3=textbox_data_2, item4=textbox_data_3, item5=textbox_data_4)
boolean = BoolSelector(true)
# note: Data-Shapes
multipleinputform = Custom[MultipleInputForm ++](Description_optional=code_block_7.out0, Logo_optional=readFromFile, ButtonText_optional=code_block_7.out1, Inputs=list_create, Toggle=boolean, CancelButtonText_optional=code_block_7.out2, Width_optional=code_block_7.out3, LabelWidth_optional=code_block_7.out4)  # package Data-Shapes; Create a form with multiple inputs. see www.data-shapes.net for tutorials and infos!

# group: FILTRAR DATA
code_block_8 = CodeBlock { 1; 2; }
drawn_by = List.GetItemAtIndex(list=multipleinputform.User_Inputs, index=code_block_8.out0)
designed_by = List.GetItemAtIndex(list=multipleinputform.User_Inputs, index=code_block_8.out1)
code_block_9 = CodeBlock { 3; 4; }
checked_by = List.GetItemAtIndex(list=multipleinputform.User_Inputs, index=code_block_9.out0)
approved_by = List.GetItemAtIndex(list=multipleinputform.User_Inputs, index=code_block_9.out1)
code_block_10 = CodeBlock { 0; }
familia = List.GetItemAtIndex(list=multipleinputform.User_Inputs, index=code_block_10)

# group: Asigna parámetros a Starting View
code_block_11 = CodeBlock { "Starting View"; }
# note: GeniusLoci
sheet_byname = Custom[Sheet ByName](NameOrNumber=code_block_11)  # package Genius Loci; Collects sheets by name or number in the active or given document.
code_block_12 = CodeBlock { "Drawn By"; "Designed By"; "Checked By"; "Approved By"; }
list_create_2 = List.Create(item0=code_block_12.out0, item1=code_block_12.out1, item2=code_block_12.out2, item3=code_block_12.out3)
list_create_3 = List.Create(item0=drawn_by, item1=designed_by, item2=checked_by, item3=approved_by)
setParameterByName = Element.SetParameterByName(element=sheet_byname, parameterName=list_create_2, value=list_create_3)

# group: Reemplaza Starting View
code_block_13 = CodeBlock { "Starting View"; }
# note: GeniusLoci
sheet_byname_2 = Custom[Sheet ByName](NameOrNumber=code_block_13)
titleBlock = Sheet.TitleBlock(sheet=sheet_byname_2)
code_block_14 = CodeBlock { "Type"; }
# note: Clockwork
loadFamily = Custom[Document.LoadFamily](path=familia)  # package Clockwork for Dynamo 2.x; A very crude implementation of family loading. Will *not* reload an already loaded family of the same name.
setParameterByName_2 = Element.SetParameterByName(element=titleBlock, parameterName=code_block_14, value=loadFamily.familyTypes)
