# Dynamo graph script.dyn (Dynamo 2.12.1.8246)
# author: Felipe Bonnemaison
# Borra vistas no usadas en un modelo
# packages: archi-lab.net 2022.210.1022, Data-Shapes 2023.2.111, Genius Loci 2022.3.28

# group: Créditos
# note: CREADO POR:
# Felipe Bonnemaison
# VERSION 2.1 (UI)
# 2025.02.28
# DYNAMO:
# Dynamo 2.12
# Iron Python 2.7
# PACKAGES:
# Data-Shapes
# archi-lab.net

# group: UI: Notas
code_block = CodeBlock()
# ---------- code_block.designscript (2 lines) ----------
"Notas";
"Esta rutina eliminará todas la vistas que no estén asignadas a láminas. Adicionalmente se pueden purgar todas las familias que no estén siendo utilizadas.";
# ----------------------------------------
# note: Data-Shapes
textnote_data = Custom[TextNote Data](Title=code_block.out0, TextNote=code_block.out1)  # package Data-Shapes; Create Data for TextNote input in UI.MultipleInputForm ++ . Check out www.data-shapes.net for more informations

# group: Vistas que no estan en uso
categories = Categories("OST_Views")
all_elements_of_category = ElementsOfCategory(Category=categories)
# note: archi-lab.net
clean = archilab.Lists.Lists.Clean(list=all_elements_of_category)
categories_2 = Categories("OST_Sheets")
all_elements_of_category_2 = ElementsOfCategory(Category=categories_2)
views = Sheet.Views(sheet=all_elements_of_category_2)
flatten = List.Flatten(list=views)
python_script = Python(IN[0]=clean, IN[1]=flatten)  # CPython3
# ---------- python_script.python (14 lines) ----------
all_views=IN[0]  # Se obtienen todas las vistas disponibles
used_views=IN[1] # Se obtienen las vistas que ya están en uso

unused_views=[]  # Se crea una lista vacía para almacenar las vistas no utilizadas

# Se recorre cada vista en la lista de todas las vistas
for view in all_views:
    # Si la vista no está en la lista de vistas utilizadas
    if not(view in used_views):
        # Se agrega esa vista a la lista de vistas no utilizadas
        unused_views.append(view)
        
# La salida del script será la lista de vistas no utilizadas        
OUT=unused_views
# ----------------------------------------

# group: UI: Selección Vistas no utilizadas
code_block_2 = CodeBlock { "Selección de Vistas"; }
name = FamilyType.Name(familyType=python_script)
boolean = BoolSelector(true)
boolean_2 = BoolSelector(false)
# note: Data-Shapes
listview_data = Custom[Listview Data](InputName=code_block_2, Keys=name, Values=python_script, ShowElementCount_optionnal=boolean, ShowId_optionnal=boolean_2)  # package Data-Shapes; Create data for ListView input in UI.MultiInputForm ++ . Check out www.data-shapes.net for more infos.

# group: Schedules que no estan en uso
categories_3 = Categories("OST_Schedules")
all_elements_of_category_3 = ElementsOfCategory(Category=categories_3)
# note: archi-lab.net
clean_2 = archilab.Lists.Lists.Clean(list=all_elements_of_category_3)
categories_4 = Categories("OST_Sheets")
all_elements_of_category_4 = ElementsOfCategory(Category=categories_4)
schedules = Sheet.Schedules(sheet=all_elements_of_category_4)
flatten_2 = List.Flatten(list=schedules)
# note: GeniusLoci
get_scheduleview = Custom[Get ScheduleView](ScheduleSheetInstance=flatten_2)  # package Genius Loci; Get Schedule View from ScheduleSheetInstance.
python_script_2 = Python(IN[0]=clean_2, IN[1]=get_scheduleview)  # CPython3
# ---------- python_script_2.python (14 lines) ----------
all_schedules=IN[0]  # Se obtienen todas las vistas disponibles
used_schedules=IN[1] # Se obtienen las vistas que ya están en uso

unused_schedules=[]  # Se crea una lista vacía para almacenar las vistas no utilizadas

# Se recorre cada vista en la lista de todas las vistas
for schedule in all_schedules:
    # Si la vista no está en la lista de vistas utilizadas
    if not(schedule in used_schedules):
        # Se agrega esa vista a la lista de vistas no utilizadas
        unused_schedules.append(schedule)
        
# La salida del script será la lista de vistas no utilizadas        
OUT=unused_schedules
# ----------------------------------------

# group: UI: Selección Schedules no utilizadas
code_block_3 = CodeBlock { "Selección de Schedules"; }
name_2 = FamilyType.Name(familyType=python_script_2)
boolean_3 = BoolSelector(true)
boolean_4 = BoolSelector(false)
# note: Data-Shapes
listview_data_2 = Custom[Listview Data](InputName=code_block_3, Keys=name_2, Values=python_script_2, ShowElementCount_optionnal=boolean_3, ShowId_optionnal=boolean_4)

# group: UI: ¿Purgar?
code_block_4 = CodeBlock { "¿Purgar el archivo?"; "SI (Se purgarán todas las familias no utilizadas)"; }
boolean_5 = BoolSelector(false)
# note: Data-Shapes
boolean_input = Custom[Boolean input](InputName=code_block_4.out0, DefaultValue=boolean_5, SideText=code_block_4.out1)  # package Data-Shapes; Creates a boolean input for UI.MultipleInputForm ++ . Check out www.data-shapes.net for more infos!

# group: CREA UI
code_block_5 = CodeBlock { "VISTAS NO UTILIZADAS"; "Ejecutar"; "Cancelar"; 600; 200; }
file_path = Filename("..\..\..\..\..\..\..\..\Logo\logo.png")
file_from_path = FileObject(path=file_path)
readFromFile = Image.ReadFromFile(file=file_from_path)
list_create = List.Create(item0=textnote_data, item1=listview_data, item2=listview_data_2, item3=boolean_input)
boolean_6 = BoolSelector(true)
# note: Data-Shapes
multipleinputform = Custom[MultipleInputForm ++](Description_optional=code_block_5.out0, Logo_optional=readFromFile, ButtonText_optional=code_block_5.out1, Inputs=list_create, Toggle=boolean_6, CancelButtonText_optional=code_block_5.out2, Width_optional=code_block_5.out3, LabelWidth_optional=code_block_5.out4)  # package Data-Shapes; Create a form with multiple inputs. see www.data-shapes.net for tutorials and infos!

# group: FILTRAR DATA
code_block_6 = CodeBlock { 0; 1; 2; }
purgar_si_no = List.GetItemAtIndex(list=multipleinputform.User_Inputs, index=code_block_6.out2)
vistas_no_utilizadas = List.GetItemAtIndex(list=multipleinputform.User_Inputs, index=code_block_6.out0)
schedules_no_utilizadas = List.GetItemAtIndex(list=multipleinputform.User_Inputs, index=code_block_6.out1)

# group: Elimina vistas y schedules sin uso
list_create_2 = List.Create(item0=vistas_no_utilizadas, item1=schedules_no_utilizadas)
flatten_3 = List.Flatten(list=list_create_2)
delete = Element.Delete(element=flatten_3)

# group: Purgar
passThrough = Custom[PassThrough](passThrough=purgar_si_no, waitFor=delete)  # package archi-lab.net; Ripped this off from Clockwork. Sorry Andy.
current = Document.Current()
boolean_7 = BoolSelector(true)
purgeUnused = Document.PurgeUnused(document=current, fullPurge=boolean_7)
code_block_7 = CodeBlock { "Sin Purgar"; }
if_ = RefactoredIf(test=passThrough, true=purgeUnused, false=code_block_7)
