# Dynamo graph script.dyn "BM_ClasificaVistasSinClasificar_UI" (Dynamo 2.12.1.8246)
# author: Felipe Bonnemaison
# Busca vistas sin clasificar y las clasifica
# packages: Data-Shapes 2023.2.111, archi-lab.net 2022.210.1022, Genius Loci 2022.3.28

# group: Créditos
# note: CREADO POR:
# Felipe Bonnemaison
# VERSION 2.1 (UI)
# 2025.02.28
# DYNAMO:
# Dynamo 2.12
# Iron Python 2.7
# PACKAGES:
# Data-Shapes
# archi-lab.net
# Genius Loci

# group: UI: Notas
code_block = CodeBlock()
# ---------- code_block.designscript (2 lines) ----------
"Notas";
"Esta rutina clasificará todas la vistas sin parámetro asignado. Adicionalmente permite descargar los RevitLinks.";
# ----------------------------------------
# note: Data-Shapes
textnote_data = Custom[TextNote Data](Title=code_block.out0, TextNote=code_block.out1)  # package Data-Shapes; Create Data for TextNote input in UI.MultipleInputForm ++ . Check out www.data-shapes.net for more informations

# group: 1. Se obtienen todas las vistas disponibles
categories = Categories("OST_Views")
all_elements_of_category = ElementsOfCategory(Category=categories)
# note: archi-lab.net
clean = archilab.Lists.Lists.Clean(list=all_elements_of_category)

# group: 2. Se obtienen todas las Shedules disponibles
categories_2 = Categories("OST_Schedules")
all_elements_of_category_2 = ElementsOfCategory(Category=categories_2)
# note: archi-lab.net
clean_2 = archilab.Lists.Lists.Clean(list=all_elements_of_category_2)

list_create = List.Create(item0=clean, item1=clean_2)
flatten = List.Flatten(list=list_create)

# group: 3. Obtener parametros vacios
code_block_2 = CodeBlock { "View Classification"; }
getParameterValueByName = Element.GetParameterValueByName(element=flatten, parameterName=code_block_2)
code_block_3 = CodeBlock(z=getParameterValueByName) { z==""; }

filterByBoolMask = List.FilterByBoolMask(list=flatten, mask=code_block_3)

# group: UI: Vistas sin clasificar
code_block_4 = CodeBlock { "Vistas sin clasificar"; }
name = FamilyType.Name(familyType=filterByBoolMask.in)
boolean = BoolSelector(true)
boolean_2 = BoolSelector(false)
# note: Data-Shapes
listview_data = Custom[Listview Data](InputName=code_block_4, Keys=name, Values=filterByBoolMask.in, ShowElementCount_optionnal=boolean, ShowId_optionnal=boolean_2)  # package Data-Shapes; Create data for ListView input in UI.MultiInputForm ++ . Check out www.data-shapes.net for more infos.

# group: UI: Clasificación
code_block_5 = CodeBlock { "Clasificación"; "WIP"; }
# note: Data-Shapes
textbox_data = Custom[TextBox Data](InputName=code_block_5.out0, DefaultText=code_block_5.out1)  # package Data-Shapes; Create Data for TextBox input in UI.MultipleInputForm ++ . Check out www.data-shapes.net for more informations

# group: UI: ¿Descargar RevitLinks?
code_block_6 = CodeBlock { "¿Descargar RevitLinks?"; "SI"; }
boolean_3 = BoolSelector(false)
# note: Data-Shapes
boolean_input = Custom[Boolean input](InputName=code_block_6.out0, DefaultValue=boolean_3, SideText=code_block_6.out1)  # package Data-Shapes; Creates a boolean input for UI.MultipleInputForm ++ . Check out www.data-shapes.net for more infos!

# group: CREA UI
code_block_7 = CodeBlock { "VISTAS SIN CLASIFICAR"; "Ejecutar"; "Cancelar"; 600; 200; }
file_path = Filename("..\..\..\..\..\..\..\..\Logo\logo.png")
file_from_path = FileObject(path=file_path)
readFromFile = Image.ReadFromFile(file=file_from_path)
list_create_2 = List.Create(item0=textnote_data, item1=listview_data, item2=textbox_data, item3=boolean_input)
boolean_4 = BoolSelector(true)
# note: Data-Shapes
multipleinputform = Custom[MultipleInputForm ++](Description_optional=code_block_7.out0, Logo_optional=readFromFile, ButtonText_optional=code_block_7.out1, Inputs=list_create_2, Toggle=boolean_4, CancelButtonText_optional=code_block_7.out2, Width_optional=code_block_7.out3, LabelWidth_optional=code_block_7.out4)  # package Data-Shapes; Create a form with multiple inputs. see www.data-shapes.net for tutorials and infos!

# group: FILTRAR DATA
code_block_8 = CodeBlock { 0; 1; 2; }
vistas_sin_clasificar = List.GetItemAtIndex(list=multipleinputform.User_Inputs, index=code_block_8.out0)
clasificación = List.GetItemAtIndex(list=multipleinputform.User_Inputs, index=code_block_8.out1)
links = List.GetItemAtIndex(list=multipleinputform.User_Inputs, index=code_block_8.out2)

# group: COMPLETA PARAMETRO VACIO
code_block_9 = CodeBlock { "View Classification"; }
setParameterByName = Element.SetParameterByName(element=vistas_sin_clasificar, parameterName=code_block_9, value=clasificación)

# group: DESCARGA REVITLINKS
element_types = ElementTypes("RevitLinkInstance")
all_elements_of_type = ElementsOfType(element_type=element_types)
# note: GeniusLoci
unload_revitlinkinstance = Custom[Unload RevitLinkInstance](RevitLinkInstance=all_elements_of_type)  # package Genius Loci; Unloads the Revit link provided.
code_block_10 = CodeBlock { "No se han descargado los links"; }
if_ = RefactoredIf(test=links, true=unload_revitlinkinstance, false=code_block_10)
