# Dynamo graph script.dyn (Dynamo 2.12.1.8246)
# author: Felipe Bonnemaison
# Nota: El nombre de las planillas no debe exceder los 30 caracteres.
# packages: Data-Shapes 2023.2.111, bimorphNodes 5.1.3

# group: Créditos
# note: CREADO POR:
# Felipe Bonnemaison
# VERSION 3.0 (UI)
# 2023.10.25
# DYNAMO:
# Dynamo 2.12
# Iron Python 2.7
# PACKAGES:
# Data-Shapes
# BimorphNodes

# group: UI: Notas
code_block = CodeBlock()
# ---------- code_block.designscript (2 lines) ----------
"Notas";
"Asegurarse que todas las planillas de cuantificación tengan la información revisada, ordenada y que esta información sea coherente.";
# ----------------------------------------
# note: Data-Shapes
textnote_data = Custom[TextNote Data](Title=code_block.out0, TextNote=code_block.out1)  # package Data-Shapes; Create Data for TextNote input in UI.MultipleInputForm ++ . Check out www.data-shapes.net for more informations

# group: UI: Selección Archivo Excel
code_block_2 = CodeBlock { "Selección de Archivo"; "Archivo Excel"; }
# note: Data-Shapes
filepath_data = Custom[FilePath Data](InputName=code_block_2.out0, ButtonText=code_block_2.out1)  # package Data-Shapes; Create filepath input for UI.MultipleInputForm ++ . Check out www.data-shapes.net for more infos !

# group: UI: Selección Vistas de Schedules
code_block_3 = CodeBlock { "Selección de Schedules"; }
element_types = ElementTypes("ViewSchedule")
all_elements_of_type = ElementsOfType(element_type=element_types)
name = FamilyType.Name(familyType=all_elements_of_type)
boolean = BoolSelector(true)
boolean_2 = BoolSelector(false)
# note: Data-Shapes
listview_data = Custom[Listview Data](InputName=code_block_3, Keys=name, Values=all_elements_of_type, ShowElementCount_optionnal=boolean, ShowId_optionnal=boolean_2)  # package Data-Shapes; Create data for ListView input in UI.MultiInputForm ++ . Check out www.data-shapes.net for more infos.

# group: CREA UI
code_block_4 = CodeBlock { "SCHEDULES A EXCEL"; "Ejecutar"; "Cancelar"; 600; 200; }
file_path = Filename("..\..\..\..\..\..\..\..\ARCADIS\Especialidad OOCC y Estructuras - 02 Comun\Biblioteca BIM Estructuras\06 Toolbar Revit\CustomExtensions\EyAtoolBar.extension\EyAtoolBar.tab\About.panel\about.pushbutton\logo.png")
file_from_path = FileObject(path=file_path)
readFromFile = Image.ReadFromFile(file=file_from_path)
list_create = List.Create(item0=textnote_data, item1=filepath_data, item2=listview_data)
boolean_3 = BoolSelector(true)
# note: Data-Shapes
multipleinputform = Custom[MultipleInputForm ++](Description_optional=code_block_4.out0, Logo_optional=readFromFile, ButtonText_optional=code_block_4.out1, Inputs=list_create, Toggle=boolean_3, CancelButtonText_optional=code_block_4.out2, Width_optional=code_block_4.out3, LabelWidth_optional=code_block_4.out4)  # package Data-Shapes; Create a form with multiple inputs. see www.data-shapes.net for tutorials and infos!

# group: FILTRAR DATA
code_block_5 = CodeBlock { 0; 1; }
obtener_ruta = List.GetItemAtIndex(list=multipleinputform.User_Inputs, index=code_block_5.out0)
obtener_vistas_seleccionadas = List.GetItemAtIndex(list=multipleinputform.User_Inputs, index=code_block_5.out1)

getData = Revit.Schedule.GetData(scheduleView=obtener_vistas_seleccionadas)

# group: ESCRIBIR A EXCEL
obtener_nombre_de_vistas = Element.Name(element=obtener_vistas_seleccionadas)  # "Obtener Nombre de Vistas Seleccionadas"
# note: BimorphNodes
code_block_6 = CodeBlock { 0; }
sobrescribir_archivo_excel = BoolSelector(true)
exportToExcel = Data.ExportToExcel(filePath=obtener_ruta, sheetName=obtener_nombre_de_vistas, startRow=code_block_6, startColumn=code_block_6, data=getData, overWrite=sobrescribir_archivo_excel)

# group: Control
watch = Watch(exportToExcel)
watch_2 = Watch(obtener_vistas_seleccionadas)
