# Dynamo graph script.dyn (Dynamo 2.12.1.8246)
# packages: Genius Loci 2022.3.28, Data-Shapes 2023.2.111

# group: ExportSetup Select
code_block = CodeBlock { "Export Setup"; 0; }
element_classes = ElementTypes("ExportDWGSettings")
all_elements_of_class = ElementsOfType(element_type=element_classes)
configuración_de_exportación_dwg = Element.Name(element=all_elements_of_class)  # graph output
boolean = BoolSelector(true)
dropdown_data = Custom[DropDown Data](InputName=code_block.out0, Keys=configuración_de_exportación_dwg, Values=configuración_de_exportación_dwg, DefaultValueIndex=code_block.out1, Sorted_optional=boolean)  # package Data-Shapes; Create data for DropDown input in UI.MultiInputForm ++ . Check out www.data-shapes.net for more infos.

# group: UI Laminas
code_block_2 = CodeBlock { "Laminas"; }
# note: Para que funcione correctamente
# se debe instalar los siguientes paquete:
# "Genius Loci" versión 2022.3.28
# "Archi-lab.NET" versión 2022.210.1022
# "Data-Shape" versión 2022.2.106
# note: Pasos:
# 1- Seleccione el ExportSetup que usarqa para el dwg
# 2- Seleccione las laminas que desea exportar a dwg y pdf
# 3- Indique si quiere que los pdf's se combinen o se extraigan independientes por separado
# 4- indique si quiere exportar el archi dwg (en caso de que solo quiera pdf, indicar que no)
# 5- Indique ruta donde se guardaran los archivos generados (dwg y pdf)
# 6- Presionar "Run" y esperar hasta que en el nodo "RESULTADO" indique "Success" (Solo Dynamo Player)
string = StringInput("Sheets")
byName = Category.ByName(name=string)
all_elements_of_category = ElementsOfCategory(Category=byName)
sheetNumber = Sheet.SheetNumber(sheet=all_elements_of_category)
sheetName = Sheet.SheetName(sheet=all_elements_of_category)
code_block_3 = CodeBlock(Numero=sheetNumber, Nombre=sheetName) { Numero + "_" + Nombre; }
code_block_4 = CodeBlock { 250; }
boolean_2 = BoolSelector(false)
boolean_3 = BoolSelector(true)
# note: Data-Shape
listview_data = Custom[Listview Data](InputName=code_block_2, Keys=code_block_3, Values=all_elements_of_category, Height_optionnal=code_block_4, HilightInView_optionnal=boolean_2, DisplayModeOnly_optionnal=boolean_2, ShowElementCount_optionnal=boolean_2, SortItems_optionnal=boolean_3, ShowId_optionnal=boolean_2)  # package Data-Shapes; Create data for ListView input in UI.MultiInputForm ++ . Check out www.data-shapes.net for more infos.

# group: Combinar PDF
code_block_5 = CodeBlock { "PDF Export"; ["Combinar todo en 1", "1 Por Lamina"]; [true,false]; 1; }
radiobuttons_data = Custom[RadioButtons Data](InputName=code_block_5.out0, Keys=code_block_5.out1, Values=code_block_5.out2, DefaultValueIndex=code_block_5.out3)  # package Data-Shapes; Create radio buttons input for UI.MultipleInputForm ++ .

# group: Exportar DWG
code_block_6 = CodeBlock { "DWG Export"; ["Exportar DWG", "No, Solo PDF"]; [true,false]; 0; }
radiobuttons_data_2 = Custom[RadioButtons Data](InputName=code_block_6.out0, Keys=code_block_6.out1, Values=code_block_6.out2, DefaultValueIndex=code_block_6.out3)

# group: UI Guardar en:
code_block_7 = CodeBlock { "Guardar en:"; "Browser"; }
directorypath_data = Custom[DirectoryPath Data](InputName=code_block_7.out0, ButtonText=code_block_7.out1)  # package Data-Shapes; Creates a DirectoryPath input for UI.MultipleInputForm ++ . Check out www.data-shapes.net for more infos!

# group: UI Build
code_block_8 = CodeBlock { "Exportar DWG y PDF"; "Exportar"; "Cancelar"; 950; 650; }
file_path = Filename("..\..\About.panel\about.pushbutton\logo.png")
list_create = List.Create(item0=dropdown_data, item1=listview_data, item2=radiobuttons_data, item3=radiobuttons_data_2, item4=directorypath_data)
boolean_4 = BoolSelector(true)
string_2 = StringInput("https://www.youtube.com/watch?v=2Q_ZzBGPdqE")
multipleinputform = Custom[MultipleInputForm ++](Description_optional=code_block_8.out0, Logo_optional=file_path, ButtonText_optional=code_block_8.out1, Inputs=list_create, Toggle=boolean_4, LinkToHelp_optional=string_2, CancelButtonText_optional=code_block_8.out2, MaxHeight_optional=code_block_8.out3, Width_optional=code_block_8.out4)  # package Data-Shapes; Create a form with multiple inputs. see www.data-shapes.net for tutorials and infos!

# group: Organización de Inputs
code_block_9 = CodeBlock { 0; 1; 2; 3; 4; }
laminas = List.GetItemAtIndex(list=multipleinputform.User_Inputs, index=code_block_9.out1)
guardar = List.GetItemAtIndex(list=multipleinputform.User_Inputs, index=code_block_9.out4)
export_pdf = List.GetItemAtIndex(list=multipleinputform.User_Inputs, index=code_block_9.out2)
exportSetup = List.GetItemAtIndex(list=multipleinputform.User_Inputs, index=code_block_9.out0)
export_dwg = List.GetItemAtIndex(list=multipleinputform.User_Inputs, index=code_block_9.out3)

# group: Obtener Nombre de Laminas para PDF y DWG
string_3 = StringInput("COD_CLIENTE")
getParameterValueByName = Element.GetParameterValueByName(element=laminas@L1, parameterName=string_3)
watch = Watch(getParameterValueByName)
string_4 = StringInput("_")
code_block_10 = CodeBlock { 1; }
insert = List.Insert(list=getParameterValueByName@L1, element=string_4, index=[code_block_10, code_block_10], lacing=Longest)
string_5 = StringInput("REV")
getParameterValueByName_2 = Element.GetParameterValueByName(element=laminas@L1, parameterName=string_5)
code_block_11 = CodeBlock { 2; }
insert_2 = List.Insert(list=insert@L2, element=getParameterValueByName_2, index=[code_block_11, code_block_11], lacing=Longest)
concat = String.Concat(string0=insert_2)
flatten = List.Flatten(list=concat)

# note: GeniusLoci 2022.3.28
exportPDF = Custom[ExportPDF](DirectoryPath=guardar, view=laminas, Filename=flatten, Combine=export_pdf)  # package Genius Loci; Works only in Revit 2022 and later. Exports a selection of views in PDF format.
export_dwg_in_document = Custom[Export DWG in Document](DirectoryPath=guardar, view=laminas, Filename=flatten, ExportSetup=exportSetup, RunIt=export_dwg)  # package Genius Loci; Export views to DWG with export setup in the active or given document. Based on a script by Konrad K Sobon.
RESULTADO = Watch(export_dwg_in_document)
