# Dynamo graph script.dyn "Exportar NWC" (Dynamo 2.19.3.6394)
# author: Sebastián Sáez S.
# Exportador de multiples vistas NWC para Coord. BIM (entrar antes de ejecutar para filtrar las vistas)
# packages: Data-Shapes 2025.3.120, Rhythm 2025.10.3

code_block = CodeBlock { "Exportar NWC"; "Export"; "Cancel"; 800; 400; }

# group: Titulo y descripción
code_block_2 = CodeBlock { "NWC EXPORT"; "Exportador de vistas de coordinación a NWC"; }
textnote_data = Custom[TextNote Data](Title=code_block_2.out0, TextNote=code_block_2.out1)  # package Data-Shapes; Create Data for TextNote input in UI.MultipleInputForm ++ . Check out www.data-shapes.net for more informations

# group: Listado de todas las Vistas
categories = Categories("OST_Views")
all_elements_of_category = ElementsOfCategory(Category=categories)
boolean = BoolSelector(false)
clean = List.Clean(list=all_elements_of_category, preserveIndices=boolean)
code_block_3 = CodeBlock { 300; }
boolean_2 = BoolSelector(false)
boolean_3 = BoolSelector(true)
name = Element.Name(element=clean)

# group: Listado de todas las Vistas > Buscar por palabra contenida en el Nombre de la Vista
name_2 = Element.Name(element=clean, lacing=Longest)
que_contenga = StringInput("3713A-ES-")  # graph input
contains = String.Contains(string=name_2, searchFor=que_contenga)

# group: Filtrado de Vistas con el nombre buscado
filterByBoolMask = List.FilterByBoolMask(list=clean, mask=contains)
boolean_4 = BoolSelector(false)
clean_2 = List.Clean(list=filterByBoolMask.in, preserveIndices=boolean_4)
flatten = List.Flatten(list=clean_2)

# group (continued): Listado de todas las Vistas
name_3 = Element.Name(element=flatten)
listview_data = Custom[Listview Data](Keys=name_3, Values=flatten, Height_optionnal=code_block_3, HilightInView_optionnal=boolean_2, DisplayModeOnly_optionnal=boolean_2, ShowElementCount_optionnal=boolean_2, SortItems_optionnal=boolean_3, ShowId_optionnal=boolean_2)  # package Data-Shapes; Create data for ListView input in UI.MultiInputForm ++ . Check out www.data-shapes.net for more infos.

# group: Save Path
code_block_4 = CodeBlock { "Guardar en:"; "Browser"; }
directorypath_data = Custom[DirectoryPath Data](InputName=code_block_4.out0, ButtonText=code_block_4.out1)  # package Data-Shapes; Creates a DirectoryPath input for UI.MultipleInputForm ++ . Check out www.data-shapes.net for more infos!

list_create = List.Create(item0=textnote_data, item1=listview_data, item2=directorypath_data)
boolean_5 = BoolSelector(true)
multipleinputform = Custom[MultipleInputForm ++](Description_optional=code_block.out0, ButtonText_optional=code_block.out1, Inputs=list_create, Toggle=boolean_5, CancelButtonText_optional=code_block.out2, MaxHeight_optional=code_block.out3, Width_optional=code_block.out4)  # package Data-Shapes; Create a form with multiple inputs. see www.data-shapes.net for tutorials and infos!

# group: Exportar a NWC
code_block_5 = CodeBlock { 0; 1; }
getItemAtIndex = List.GetItemAtIndex(list=multipleinputform.User_Inputs, index=code_block_5.out0)
getItemAtIndex_2 = List.GetItemAtIndex(list=multipleinputform.User_Inputs, index=code_block_5.out1)
python_script = Python(IN[0]=getItemAtIndex, IN[1]=getItemAtIndex_2)  # IronPython2; graph output
# ---------- python_script.python (50 lines) ----------
# Load the Python Standard and DesignScript Librariesimport
import clr

clr.AddReference('RevitAPI')
from Autodesk.Revit.DB import*

clr.AddReference('RevitServices')
from RevitServices.Persistence import DocumentManager

clr.AddReference('ProtoGeometry')
from Autodesk.DesignScript.Geometry import*

import System
from System.Collections.Generic import*

#Paso 2. Conectar con el Documento Actual.
doc = DocumentManager.Instance.CurrentDBDocument

#Paso 3. Obtener nombres de las Vistas.
names = IN[0]

#Paso 4. obtener directorio donde se guardaran los archivos
directory = IN[1]

#Paso 5. Usar FilterElementCollector
#Esta clase es usada para buscar, filtrar e iterar entre un set de elementos.
collector = FilteredElementCollector(doc).OfClass(View)

#Paso 6. Usar NavisworksExporterOptions
NavisExport = NavisworksExportOptions()
NavisExport.ExportScope = NavisworksExportScope.View
NavisExport.ExportLinks = True

#Paso 7. Crear una Nueva lista para los resultados.
OUT = []

#Paso 8. Crear un loop en todas las vistas filtradas para guardar en nwc.
for i in names:
    FindViewString = i.Name
    OUT.append(FindViewString)

    for view in collector:
        if (view.ViewType == ViewType.ThreeD and view.Name.Contains(FindViewString)):
            NavisExport.ViewId = view.Id
            doc.Export(directory, view.Name + ".nwc", NavisExport)
				
				
				
				
				
# ----------------------------------------

string = StringInput("View Classification")
string_2 = StringInput("WIP-COORDINACIÓN")
string_3 = StringInput("Equal")
ʳʰʸᵗʰᵐ_elementfilter = Rhythm.Revit.ElementFilter.ElementFilter.ByParameterStringValue(parameterName=string, value=string_2, filterMethod=string_3, lacing=Longest)  # unwired: elements
list_create_2 = List.Create(item0=ʳʰʸᵗʰᵐ_elementfilter)
boolean_6 = BoolSelector(false)
clean_3 = List.Clean(list=list_create_2, preserveIndices=boolean_6)
flatten_2 = List.Flatten(list=clean_3)
name_4 = Element.Name(element=flatten_2)
element_classes = ElementTypes()  # nothing selected
