# Dynamo graph script.dyn "BM_BorraFormulasDeFamiliasRvt_UI" (Dynamo 2.12.1.8246)
# author: Felipe Bonnemaison
# Borra fórmulas en familias descargadas de internet.
# packages: Genius Loci 2024.5.29, archi-lab.net 2024.217.1024, Data-Shapes 2023.2.111

# group: Créditos
# note: CREADO POR:
# Felipe Bonnemaison
# VERSION 3.0 (UI)
# 2025.02.27
# DYNAMO:
# Dynamo 2.19
# Iron Python 2.7
# PACKAGES:
# Data-Shapes
# Genius Loci
# archi-lab.net

# group: UI: Notas
code_block = CodeBlock()
# ---------- code_block.designscript (2 lines) ----------
"Notas:";
"Seleccionar parámetros de familia, de los cuales deben eliminarse las fórmulas aplicadas. Útil para limpiar familias descargadas de internet.";
# ----------------------------------------
# note: Data-Shapes
textnote_data = Custom[TextNote Data](Title=code_block.out0, TextNote=code_block.out1)  # package Data-Shapes; Create Data for TextNote input in UI.MultipleInputForm ++ . Check out www.data-shapes.net for more informations

# group: UI: Selección
code_block_2 = CodeBlock { "Seleccionar Familia"; "Familia"; }
boolean = BoolSelector(true)
# note: Data Shapes
selectmodelelements_data = Custom[SelectModelElements Data](InputName=code_block_2.out0, ButtonText=code_block_2.out1, SelectSingleElement=boolean)  # package Data-Shapes; Creates a Revit element selection input for UI.MultipleInputForm++ . Check out www.data-shapes.net for more infos!

# group: UI: Parámetros
code_block_3 = CodeBlock { "Parámetro Texto 01 >>"; "Keynote"; }
# note: Data-Shapes
textbox_data = Custom[TextBox Data](InputName=code_block_3.out0, DefaultText=code_block_3.out1)  # package Data-Shapes; Create Data for TextBox input in UI.MultipleInputForm ++ . Check out www.data-shapes.net for more informations
code_block_4 = CodeBlock { "Parámetro Texto 02 >>"; "Model"; }
textbox_data_2 = Custom[TextBox Data](InputName=code_block_4.out0, DefaultText=code_block_4.out1)
code_block_5 = CodeBlock { "Parámetro Texto 03 >>"; "Manufacturer"; }
textbox_data_3 = Custom[TextBox Data](InputName=code_block_5.out0, DefaultText=code_block_5.out1)
code_block_6 = CodeBlock { "Parámetro Texto 04 >>"; "Type Comments"; }
textbox_data_4 = Custom[TextBox Data](InputName=code_block_6.out0, DefaultText=code_block_6.out1)
code_block_7 = CodeBlock { "Parámetro Texto 05 >>"; "Description"; }
textbox_data_5 = Custom[TextBox Data](InputName=code_block_7.out0, DefaultText=code_block_7.out1)
code_block_8 = CodeBlock { "Parámetro Número 06 >>"; "Cost"; }
textbox_data_6 = Custom[TextBox Data](InputName=code_block_8.out0, DefaultText=code_block_8.out1)

list_create = List.Create(item0=textnote_data, item1=selectmodelelements_data, item2=textbox_data, item3=textbox_data_2, item4=textbox_data_3, item5=textbox_data_4, item6=textbox_data_5, item7=textbox_data_6)

# group: Crea UI
code_block_9 = CodeBlock { "BORRA FORMULAS"; "Ejecutar"; "Cancelar"; 700; 600; 200; }
file_path = Filename("..\..\..\..\..\..\..\..\Logo\logo.png")
file_from_path = FileObject(path=file_path)
readFromFile = Image.ReadFromFile(file=file_from_path)
boolean_2 = BoolSelector(true)  # graph input
# note: Data-Shapes
multipleinputform = Custom[MultipleInputForm ++](Description_optional=code_block_9.out0, Logo_optional=readFromFile, ButtonText_optional=code_block_9.out1, Inputs=list_create, Toggle=boolean_2, CancelButtonText_optional=code_block_9.out2, MaxHeight_optional=code_block_9.out3, Width_optional=code_block_9.out4, LabelWidth_optional=code_block_9.out5)  # package Data-Shapes; Create a form with multiple inputs. see www.data-shapes.net for tutorials and infos!

# group: Filtrar Data
code_block_10 = CodeBlock { 0; 1; 2; 3; 4; 5; 6; }
getItemAtIndex = List.GetItemAtIndex(list=multipleinputform.User_Inputs, index=code_block_10.out0)
getItemAtIndex_2 = List.GetItemAtIndex(list=multipleinputform.User_Inputs, index=code_block_10.out1)
getItemAtIndex_3 = List.GetItemAtIndex(list=multipleinputform.User_Inputs, index=code_block_10.out2)
getItemAtIndex_4 = List.GetItemAtIndex(list=multipleinputform.User_Inputs, index=code_block_10.out3)
getItemAtIndex_5 = List.GetItemAtIndex(list=multipleinputform.User_Inputs, index=code_block_10.out4)
getItemAtIndex_6 = List.GetItemAtIndex(list=multipleinputform.User_Inputs, index=code_block_10.out5)
getItemAtIndex_7 = List.GetItemAtIndex(list=multipleinputform.User_Inputs, index=code_block_10.out6)

# group: Elimina Filtros
# note: GeniusLoci
familydocument_open = Custom[FamilyDocument Open](FamilyOrFamilyInstance=getItemAtIndex)  # package Genius Loci; Gets the familyDocument by family or family instance. (Opens the family in the background) Use the "FamilyDocument Close" node to close the familyDocument.
list_create_2 = List.Create(item0=getItemAtIndex_2, item1=getItemAtIndex_3, item2=getItemAtIndex_4, item3=getItemAtIndex_5, item4=getItemAtIndex_6, item5=getItemAtIndex_7)
python_script = Python(IN[0]=familydocument_open, IN[1]=list_create_2)  # CPython3
# ---------- python_script.python (44 lines) ----------
import clr
clr.AddReference('RevitAPI')
from Autodesk.Revit.DB import *

clr.AddReference('RevitServices')
import RevitServices
from RevitServices.Persistence import DocumentManager
from RevitServices.Transactions import TransactionManager

# Obtiene el documento actual de Revit
# doc = DocumentManager.Instance.CurrentDBDocument
doc = IN[0]

# Obtiene la lista de nombres de parámetros de entrada
param_names = IN[1]

# Obtiene la lista de parámetros de la familia actual
param_list = doc.FamilyManager.GetParameters()
names = [p.Definition.Name for p in param_list]

# Inicializa una lista para almacenar los resultados
results = []

# Verifica si cada nombre de parámetro en la lista existe en la lista de nombres
for param_name in param_names:
    par1 = None
    if param_name in names:
        par1 = param_list[names.index(param_name)]
    
    # Si el parámetro existe, intenta eliminar la fórmula asociada
    if par1 is not None:
        TransactionManager.Instance.EnsureInTransaction(doc)
        try:
            # Elimina la fórmula del parámetro
            doc.FamilyManager.SetFormula(par1, None)
            results.append(f'Success: {param_name}')
        except Exception as e:
            results.append(f'Failed: {param_name} - {str(e)}')
        TransactionManager.Instance.TransactionTaskDone()
    else:
        results.append(f'Failed: {param_name} - Parameter not found')

# Salida de los resultados
OUT = results
# ----------------------------------------
# note: archilab
passThrough = Custom[PassThrough](passThrough=familydocument_open, waitFor=python_script)  # package archi-lab.net; Ripped this off from Clockwork. Sorry Andy.
familydocument_load = Custom[FamilyDocument Load](familyDocument=passThrough)  # package Genius Loci; Load the family as familyDocument, existing family will be overwritten. Use the "FamilyDocument Close" node to close the familyDocument.
passThrough_2 = Custom[PassThrough](passThrough=getItemAtIndex, waitFor=familydocument_load)
elementType = Element.ElementType(element=passThrough_2)
code_block_11 = CodeBlock { "URL"; }
list_create_3 = List.Create(item0=code_block_11, item1=list_create_2)
flatten = List.Flatten(list=list_create_3)
code_block_12 = CodeBlock { ""; 0; }
list_create_4 = List.Create(item0=code_block_12.out0, item1=code_block_12.out0, item2=code_block_12.out0, item3=code_block_12.out0, item4=code_block_12.out0, item5=code_block_12.out0, item6=code_block_12.out1)
setParameterByName = Element.SetParameterByName(element=elementType, parameterName=flatten, value=list_create_4)
