# Dynamo graph script.dyn (Dynamo 2.12.1.8246)
# packages: Data-Shapes 2023.2.111

# group: UI Categories
categories = Categories("OST_TextNotes")
select_model_elements_of = Custom[Select Model Elements of Category](Categories=categories)  # package Data-Shapes; Allows to perform a manual selection with a category filter.

# group: UI Select Element
code_block = CodeBlock { "Select Element"; "Select Model Element"; }
selectmodelelements_data = Custom[SelectModelElements Data](InputName=code_block.out0, ButtonText=code_block.out1, CategoryFilter=categories)  # package Data-Shapes; Creates a Revit element selection input for UI.MultipleInputForm++ . Check out www.data-shapes.net for more infos!

# group: UI Botón si/no
code_block_2 = CodeBlock { "UPPER or lower"; ["UPPER", "lower"]; [true, false]; 0; }
radiobuttons_data = Custom[RadioButtons Data](InputName=code_block_2.out0, Keys=code_block_2.out1, Values=code_block_2.out2, DefaultValueIndex=code_block_2.out3)  # package Data-Shapes; Create radio buttons input for UI.MultipleInputForm ++ .

# group: UI BUILD
string = StringInput("MAYUSCULA o minuscula")
file_path = Filename("..\..\..\..\..\..\..\..\ARCADIS\Especialidad OOCC y Estructuras - 02 Comun\Biblioteca BIM Estructuras\05 Toolbar Revit\EyAtoolBar.extension\EyAtoolBar.tab\About.panel\about.pushbutton\logo.png")
string_2 = StringInput("APLICAR")
list_create = List.Create(item0=selectmodelelements_data, item1=radiobuttons_data)
boolean = BoolSelector(true)
string_3 = StringInput("CANCELAR")
code_block_3 = CodeBlock { 900; 500; }
multipleinputform = Custom[MultipleInputForm ++](Description_optional=string, Logo_optional=file_path, ButtonText_optional=string_2, Inputs=list_create, Toggle=boolean, CancelButtonText_optional=string_3, MaxHeight_optional=code_block_3.out0, Width_optional=code_block_3.out1)  # package Data-Shapes; Create a form with multiple inputs. see www.data-shapes.net for tutorials and infos!

code_block_4 = CodeBlock { 0; 1; }
getItemAtIndex = List.GetItemAtIndex(list=multipleinputform.User_Inputs, index=code_block_4.out0)
text = TextNote.Text(textNote=getItemAtIndex)
getItemAtIndex_2 = List.GetItemAtIndex(list=multipleinputform.User_Inputs, index=code_block_4.out1)
changeCase = String.ChangeCase(string=text, upper=getItemAtIndex_2)
setText = TextNote.SetText(textNote=getItemAtIndex, value=changeCase)
