# Dynamo graph script.dyn (Dynamo 2.12.1.8246)
# packages: Filangas 1.0.0, Clockwork for Dynamo 2.x 2.12.0, Data-Shapes 2023.2.111

# group: UI NOTA: Modo de Uso
code_block = CodeBlock()
# ---------- code_block.designscript (2 lines) ----------
"Modo de Uso";
"Seleccione las planillas excel de los modelos obtenidos desde SAP2000, se generara un Modelo con las diferencias entre ambas versiones";
# ----------------------------------------
textnote_data = Custom[TextNote Data](Title=code_block.out0, TextNote=code_block.out1)  # package Data-Shapes; Create Data for TextNote input in UI.MultipleInputForm ++ . Check out www.data-shapes.net for more informations

# group: UI Buscar Archivo Actual
code_block_2 = CodeBlock { "Modelo Actual"; ""; "Browse"; }
filepath_data = Custom[FilePath Data](InputName=code_block_2.out0, ButtonText=code_block_2.out2)  # package Data-Shapes; Create filepath input for UI.MultipleInputForm ++ . Check out www.data-shapes.net for more infos !

# group: UI Buscar archivo Antiguo
code_block_3 = CodeBlock { "Modelo Antiguo"; ""; "Browse"; }
filepath_data_2 = Custom[FilePath Data](InputName=code_block_3.out0, ButtonText=code_block_3.out2)

# group: UI Build
code_block_4 = CodeBlock { "Generar Modelo de comparación"; "Comparar"; true; "Cancel"; 700; 500; }
file_path = Filename("..\..\..\..\..\..\ARCADIS\Especialidad OOCC y Estructuras - 02 Comun\Biblioteca BIM Estructuras\05 Toolbar Revit\EyAtoolBar.extension\EyAtoolBar.tab\About.panel\about.pushbutton\logo.png")
list_create = List.Create(item0=textnote_data, item1=filepath_data, item2=filepath_data_2)
multipleinputform = Custom[MultipleInputForm ++](Description_optional=code_block_4.out0, Logo_optional=file_path, ButtonText_optional=code_block_4.out1, Inputs=list_create, Toggle=code_block_4.out2, CancelButtonText_optional=code_block_4.out3, MaxHeight_optional=code_block_4.out4, Width_optional=code_block_4.out5)  # package Data-Shapes; Create a form with multiple inputs. see www.data-shapes.net for tutorials and infos!

code_block_5 = CodeBlock { 0; 1; }
getItemAtIndex = List.GetItemAtIndex(list=multipleinputform.User_Inputs, index=code_block_5.out0)
file_from_path = FileObject(path=getItemAtIndex)
code_block_6 = CodeBlock { false; }

# group: Se obtiene lista con ID de cada nodo con sus coordenadas x, y x
string = StringInput("Joint Coordinates")
importExcel = Data.ImportExcel(file=file_from_path, sheetName=string, showExcel=code_block_6)
code_block_7 = CodeBlock { 2; }
dropItems = List.DropItems(list=importExcel, amount=code_block_7)
deconstruct = List.Deconstruct(list=dropItems)
transpose = List.Transpose(lists=deconstruct.rest)
code_block_8 = CodeBlock(l=transpose) { NodoX=l[3]; NodoY=l[4]; NodoZ=l[5]; NodoID=l[0]; }

# note: Se extrae unidades de dimensiones
code_block_9 = CodeBlock(l=deconstruct.first) { Units=l[3]; }
# note: Se pasan unidades a metros
# (nodos personalizados)
pasarAMetros = Custom[PasarAMetros](Num=code_block_8.NodoX, Unt=code_block_9)  # package Filangas; Transforma unidades de variable a metros.
# note: Se pasan unidades a milímetros
convert_between_units = DynamoConvert(pasarAMetros, MeasurementType="Length", FromConversion="Meters", ToConversion="Millimeters")
pasarAMetros_2 = Custom[PasarAMetros](Num=code_block_8.NodoY, Unt=code_block_9)
convert_between_units_2 = DynamoConvert(pasarAMetros_2, MeasurementType="Length", FromConversion="Meters", ToConversion="Millimeters")
pasarAMetros_3 = Custom[PasarAMetros](Num=code_block_8.NodoZ, Unt=code_block_9)
convert_between_units_3 = DynamoConvert(pasarAMetros_3, MeasurementType="Length", FromConversion="Meters", ToConversion="Millimeters")
convierte_en_string = Python(IN[0]=code_block_8.NodoID)  # IronPython2
# ---------- convierte_en_string.python (21 lines) ----------
# Load the Python Standard and DesignScript Libraries
import sys
import clr
clr.AddReference('ProtoGeometry')
from Autodesk.DesignScript.Geometry import *

# The inputs to this node will be stored as a list in the IN variables.
dataEnteringNode = IN

# Place your code below this line

STR_List = []

for i in IN[0]:
	if isinstance(i, int) or isinstance(i, float):
		STR_List.append(str(int(round(i,0))))
	else:
		STR_List.append(i)

# Assign your output to the OUT variable.
OUT = STR_List
# ----------------------------------------
code_block_10 = CodeBlock { false; }

# group: Se obtiene lista con ID, nodo inicial y nodo final de cada elemento.
string_2 = StringInput("Connectivity - Frame")
importExcel_2 = Data.ImportExcel(file=file_from_path, sheetName=string_2, showExcel=code_block_10)
code_block_11 = CodeBlock { 3; }
dropItems_2 = List.DropItems(list=importExcel_2, amount=code_block_11)
transpose_2 = List.Transpose(lists=dropItems_2)
code_block_12 = CodeBlock(l=transpose_2) { ElemID=l[0]; NodoIinicial=l[1]; NodoFinal=l[2]; LargoElem=l[4]; }

convierte_en_string_2 = Python(IN[0]=code_block_12.NodoIinicial)  # IronPython2; same code as convierte_en_string
convierte_en_string_3 = Python(IN[0]=code_block_12.NodoFinal)  # IronPython2; same code as convierte_en_string

# group: Creación de estructura en Dynamo
# note: Creación de Points
byCoordinates = Point.ByCoordinates(x=convert_between_units, y=convert_between_units_2, z=convert_between_units_3)
punto_inicial = List.IndexOf(list=convierte_en_string, element=convierte_en_string_2)
getItemAtIndex_2 = List.GetItemAtIndex(list=byCoordinates, index=punto_inicial)
punto_final = List.IndexOf(list=convierte_en_string, element=convierte_en_string_3)
getItemAtIndex_3 = List.GetItemAtIndex(list=byCoordinates, index=punto_final)
# note: Vector para obtener la dirección del elemento
byTwoPoints = Vector.ByTwoPoints(start=getItemAtIndex_2, end=getItemAtIndex_3)
byOriginNormal = Plane.ByOriginNormal(origin=getItemAtIndex_2, normal=byTwoPoints)
code_block_13 = CodeBlock { 200; }
# note: Creación de Profile (cuadrado)
byWidthLength = Rectangle.ByWidthLength(plane=byOriginNormal, width=code_block_13, length=code_block_13)
# note: Creación de Path
byStartPointEndPoint = Line.ByStartPointEndPoint(startPoint=getItemAtIndex_2, endPoint=getItemAtIndex_3)
# note: Se crean los elementos de sección cuadrada
bySweep = Solid.BySweep(profile=byWidthLength, path=byStartPointEndPoint)

categories = Categories("OST_GenericModel")
# note: Se crean elementos en Revit
byGeometry = DirectShape.ByGeometry(geometry=bySweep, category=categories, lacing=CrossProduct)
code_block_14 = CodeBlock { false; }

# group: Se obtiene ID de elemento con su sección
string_3 = StringInput("Frame Section Assignments")
importExcel_3 = Data.ImportExcel(file=file_from_path, sheetName=string_3, showExcel=code_block_14)
code_block_15 = CodeBlock { 3; }
dropItems_3 = List.DropItems(list=importExcel_3, amount=code_block_15)
transpose_3 = List.Transpose(lists=dropItems_3)
code_block_16 = CodeBlock(l=transpose_3) { ElemID=l[0]; Seccion=l[3]; }

convierte_en_string_4 = Python(IN[0]=code_block_16.ElemID)  # IronPython2; same code as convierte_en_string
getItemAtIndex_4 = List.GetItemAtIndex(list=multipleinputform.User_Inputs, index=code_block_5.out1)
file_from_path_2 = FileObject(path=getItemAtIndex_4)
code_block_17 = CodeBlock { false; }

# group: Se obtiene ID de elemento con su sección (modelo antiguo)
string_4 = StringInput("Frame Section Assignments")
importExcel_4 = Data.ImportExcel(file=file_from_path_2, sheetName=string_4, showExcel=code_block_17)
code_block_18 = CodeBlock { 3; }
dropItems_4 = List.DropItems(list=importExcel_4, amount=code_block_18)
transpose_4 = List.Transpose(lists=dropItems_4)
code_block_19 = CodeBlock(l=transpose_4) { ElemID=l[0]; Seccion=l[3]; }

convierte_en_string_5 = Python(IN[0]=code_block_19.ElemID)  # IronPython2; same code as convierte_en_string
# note: Identifica los elementos nuevos
python_script = Python(IN[0]=convierte_en_string_4, IN[1]=convierte_en_string_5)  # IronPython2
# ---------- python_script.python (24 lines) ----------
# Load the Python Standard and DesignScript Libraries
import sys
import clr
clr.AddReference('ProtoGeometry')
from Autodesk.DesignScript.Geometry import *

# The inputs to this node will be stored as a list in the IN variables.
dataEnteringNode = IN

FramesNuevos = IN[0]
FramesViejos = IN[1]

isNew = []

for n in IN[0]:
	if list.Contains(IN[1],n)==False:
		isNew.append(True)
	else:
		isNew.append(False)

# Place your code below this line

# Assign your output to the OUT variable.
OUT = isNew
# ----------------------------------------

# group: Creación de parámetros de proyectos
code_block_20 = CodeBlock { ["Cambio","Perfil Antiguo","Perfil Nuevo"]; }
string_5 = StringInput("Text")
select_parameter_type = ParameterType("Text")
select_builtin_parameter_group = BuiltInParameterGroup("PG_TEXT")
boolean = BoolSelector(true)
createProjectParameter = Parameter.CreateProjectParameter(parameterName=code_block_20, groupName=string_5, type=select_parameter_type, group=select_builtin_parameter_group, instance=boolean, categoryList=categories)

convierte_en_string_6 = Python(IN[0]=code_block_16.Seccion)  # IronPython2; same code as convierte_en_string

# group: Colorea y completa info de los elementos nuevos
filterByBoolMask = List.FilterByBoolMask(list=byGeometry, mask=python_script)
color_palette = ColorPalette({R: 34, G: 139, B: 34, A: 255})
overrideColorInView = Element.OverrideColorInView(element=filterByBoolMask.in, color=color_palette)
filterByBoolMask_2 = List.FilterByBoolMask(list=bySweep, mask=python_script)
byGeometryColor = Modifiers.GeometryColor.ByGeometryColor(geometry=filterByBoolMask_2.in, color=color_palette)
string_6 = StringInput("Cambio")
string_7 = StringInput("Perfil Nuevo")
setParameterByName = Element.SetParameterByName(element=filterByBoolMask.in, parameterName=string_6, value=string_7)
string_8 = StringInput("Perfil Nuevo")
filterByBoolMask_3 = List.FilterByBoolMask(list=convierte_en_string_6, mask=python_script)

# note: Se necesita que los parámetros de proyecto estén creados antes de asignarles un valor
passthrough = Custom[Passthrough](passThrough=setParameterByName, waitFor=createProjectParameter)  # package Clockwork for Dynamo 2.x; Forces a sequential order of execution. The node wired into the output of the Passthrough node will be executed *after* the node wired into the waitFor input (e.g. important for some Revit operations). The value of the passThrough input will be passed on to the node wired into the output port of the Passthrough node.
convierte_en_string_7 = Python(IN[0]=code_block_19.Seccion)  # IronPython2; same code as convierte_en_string
# note: Identifica los elementos que cambiaron de perfil
python_script_2 = Python(IN[0]=convierte_en_string_4, IN[1]=convierte_en_string_6, IN[2]=convierte_en_string_5, IN[3]=convierte_en_string_7)  # IronPython2
# ---------- python_script_2.python (30 lines) ----------
# Load the Python Standard and DesignScript Libraries
import sys
import clr
clr.AddReference('ProtoGeometry')
from Autodesk.DesignScript.Geometry import *

# The inputs to this node will be stored as a list in the IN variables.
dataEnteringNode = IN

ID_Actual = IN[0]
Shape_Actual = IN[1]
ID_Old = IN[2]
Shape_Old = IN[3]

isDifferent = []

for IDi, Shi in zip(ID_Actual, Shape_Actual):
	index_ID = list.IndexOf(ID_Old, IDi)
	if index_ID != -1:
		if Shi == Shape_Old[index_ID]:
			isDifferent.append(False)
		else:
			isDifferent.append(True)
	else:
		isDifferent.append(False)
		
# Place your code below this line

# Assign your output to the OUT variable.
OUT = isDifferent
# ----------------------------------------

# group: Colorea y completa info de los elementos cambiados
filterByBoolMask_4 = List.FilterByBoolMask(list=byGeometry, mask=python_script_2)
color_palette_2 = ColorPalette({R: 255, G: 0, B: 0, A: 255})
overrideColorInView_2 = Element.OverrideColorInView(element=filterByBoolMask_4.in, color=color_palette_2)
filterByBoolMask_5 = List.FilterByBoolMask(list=bySweep, mask=python_script_2)
byGeometryColor_2 = Modifiers.GeometryColor.ByGeometryColor(geometry=filterByBoolMask_5.in, color=color_palette_2)
string_9 = StringInput("Perfil Antiguo")
setParameterByName_2 = Element.SetParameterByName(element=filterByBoolMask_4.in, parameterName=string_9, value=convierte_en_string_7)
string_10 = StringInput("Perfil Nuevo")
filterByBoolMask_6 = List.FilterByBoolMask(list=convierte_en_string_6, mask=python_script_2)
setParameterByName_3 = Element.SetParameterByName(element=filterByBoolMask_4.in, parameterName=string_10, value=filterByBoolMask_6.in)
string_11 = StringInput("Cambio")
string_12 = StringInput("Modificar Sección")
setParameterByName_4 = Element.SetParameterByName(element=filterByBoolMask_4.in, parameterName=string_11, value=string_12)

passthrough_2 = Custom[Passthrough](passThrough=setParameterByName_2, waitFor=createProjectParameter)
passthrough_3 = Custom[Passthrough](passThrough=setParameterByName_3, waitFor=createProjectParameter)
code_block_21 = CodeBlock { false; }

# group: Se obtiene información de los ejes del modelo
string_13 = StringInput("Grid Lines")
importExcel_5 = Data.ImportExcel(file=file_from_path, sheetName=string_13, showExcel=code_block_21)
code_block_22 = CodeBlock { 2; }
dropItems_5 = List.DropItems(list=importExcel_5, amount=code_block_22)
deconstruct_2 = List.Deconstruct(list=dropItems_5)
transpose_5 = List.Transpose(lists=deconstruct_2.rest)
code_block_23 = CodeBlock(l=transpose_5) { Direccion=l[1]; Nombre=l[2]; Distancia=l[3]; }
# note: Se extrae unidades de dimensiones
code_block_24 = CodeBlock(l=deconstruct_2.first) { Units=l[3]; }
# note: Se pasan unidades a metros
# (nodos personalizados)
pasarAMetros_4 = Custom[PasarAMetros](Num=code_block_23.Distancia, Unt=code_block_24)

# group: Creación de ejes y niveles en Revit
string_14 = StringInput("X")
eq = code_block_23.Direccion == string_14
filterByBoolMask_7 = List.FilterByBoolMask(list=code_block_23.Direccion, mask=eq)
string_15 = StringInput("Y")
eq_2 = filterByBoolMask_7.out == string_15
filterByBoolMask_8 = List.FilterByBoolMask(list=filterByBoolMask_7.out, mask=eq_2)
# note: Se pasan unidades a milímetros
convert_between_units_4 = DynamoConvert(pasarAMetros_4, MeasurementType="Length", FromConversion="Meters", ToConversion="Millimeters")
# note: Separación por ejes X, Y y Z
filterByBoolMask_9 = List.FilterByBoolMask(list=convert_between_units_4, mask=eq)
filterByBoolMask_10 = List.FilterByBoolMask(list=filterByBoolMask_9.out, mask=eq_2)
minimumItem = List.MinimumItem(list=filterByBoolMask_10.in)
code_block_25 = CodeBlock(y=minimumItem) { y-1000; }
# note: Eje X
code_block_26 = CodeBlock { 0; }
byCoordinates_2 = Point.ByCoordinates(x=filterByBoolMask_9.in, y=code_block_25, z=code_block_26)
YAxis = Vector.YAxis()
maximumItem = List.MaximumItem(list=filterByBoolMask_10.in)
code_block_27 = CodeBlock(x=maximumItem, y=code_block_25) { x-y+1000; }
byStartPointDirectionLength = Line.ByStartPointDirectionLength(startPoint=byCoordinates_2, direction=YAxis, length=code_block_27)
byLine = Grid.ByLine(line=byStartPointDirectionLength)
string_16 = StringInput("Name")
filterByBoolMask_11 = List.FilterByBoolMask(list=code_block_23.Nombre, mask=eq)
python_script_3 = Python(IN[0]=filterByBoolMask_11.in)  # IronPython2
# ---------- python_script_3.python (18 lines) ----------
# Load the Python Standard and DesignScript Libraries
import sys
import clr
clr.AddReference('ProtoGeometry')
from Autodesk.DesignScript.Geometry import *

# The inputs to this node will be stored as a list in the IN variables.
dataEnteringNode = IN

Texto = []

for i in IN[0]:
	Texto.append(str(i))
	
# Place your code below this line

# Assign your output to the OUT variable.
OUT = Texto
# ----------------------------------------
setParameterByName_5 = Element.SetParameterByName(element=byLine, parameterName=string_16, value=python_script_3)
minimumItem_2 = List.MinimumItem(list=filterByBoolMask_9.in)
code_block_28 = CodeBlock(x=minimumItem_2) { x-1000; }
# note: Eje Y
code_block_29 = CodeBlock { 0; }
byCoordinates_3 = Point.ByCoordinates(x=code_block_28, y=filterByBoolMask_10.in, z=code_block_29)
XAxis = Vector.XAxis()
maximumItem_2 = List.MaximumItem(list=filterByBoolMask_9.in)
code_block_30 = CodeBlock(b=maximumItem_2, a=code_block_28) { b-a+1000; }
byStartPointDirectionLength_2 = Line.ByStartPointDirectionLength(startPoint=byCoordinates_3, direction=XAxis, length=code_block_30)
byLine_2 = Grid.ByLine(line=byStartPointDirectionLength_2)
filterByBoolMask_12 = List.FilterByBoolMask(list=filterByBoolMask_11.out, mask=eq_2)
python_script_4 = Python(IN[0]=filterByBoolMask_12.in)  # IronPython2
# ---------- python_script_4.python (17 lines) ----------
# Load the Python Standard and DesignScript Libraries
import sys
import clr
clr.AddReference('ProtoGeometry')
from Autodesk.DesignScript.Geometry import *

# The inputs to this node will be stored as a list in the IN variables.
dataEnteringNode = IN

Texto = []

for i in IN[0]:
	Texto.append(str(i))
# Place your code below this line

# Assign your output to the OUT variable.
OUT = Texto
# ----------------------------------------
setParameterByName_6 = Element.SetParameterByName(element=byLine_2, parameterName=string_16, value=python_script_4)
python_script_5 = Python(IN[0]=filterByBoolMask_12.out)  # IronPython2; same code as python_script_3
# note: Eje Z
byElevationAndName = Level.ByElevationAndName(elevation=filterByBoolMask_10.out, name=python_script_5)
byLevel = StructuralPlanView.ByLevel(level=byElevationAndName)

setParameterByName_7 = Element.SetParameterByName(element=filterByBoolMask.in, parameterName=string_8, value=filterByBoolMask_3.in)
passthrough_4 = Custom[Passthrough](passThrough=setParameterByName_7, waitFor=createProjectParameter)
