# Dynamo graph script.dyn (Dynamo 2.12.1.8246)
# packages: Filangas 1.0.0, Clockwork for Dynamo 2.x 2.12.0, Data-Shapes 2023.2.111

# group: UI NOTA: Modo de Uso
code_block = CodeBlock()
# ---------- code_block.designscript (2 lines) ----------
"Modo de Uso";
"Seleccionar planilla excel con la información de modelo obtenida desde SAP2000, para generar un modelo Revit con esta mismo información, para entregar al equipo de Modelación y generar los ajustes necesarios en los modelos de la disciplina";
# ----------------------------------------
textnote_data = Custom[TextNote Data](Title=code_block.out0, TextNote=code_block.out1)  # package Data-Shapes; Create Data for TextNote input in UI.MultipleInputForm ++ . Check out www.data-shapes.net for more informations

# group: UI Buscar Archivo
code_block_2 = CodeBlock { "Modelo Actual"; ""; "Browse"; }
filepath_data = Custom[FilePath Data](InputName=code_block_2.out0, ButtonText=code_block_2.out2)  # package Data-Shapes; Create filepath input for UI.MultipleInputForm ++ . Check out www.data-shapes.net for more infos !

# group: UI Build
code_block_3 = CodeBlock { "Generador de Modelos SAP2000"; "Generate"; true; "Cancel"; 700; 500; }
file_path = Filename("..\..\..\..\..\..\ARCADIS\Especialidad OOCC y Estructuras - 02 Comun\Biblioteca BIM Estructuras\05 Toolbar Revit\EyAtoolBar.extension\EyAtoolBar.tab\About.panel\about.pushbutton\logo.png")
list_create = List.Create(item0=textnote_data, item1=filepath_data)
multipleinputform = Custom[MultipleInputForm ++](Description_optional=code_block_3.out0, Logo_optional=file_path, ButtonText_optional=code_block_3.out1, Inputs=list_create, Toggle=code_block_3.out2, CancelButtonText_optional=code_block_3.out3, MaxHeight_optional=code_block_3.out4, Width_optional=code_block_3.out5)  # package Data-Shapes; Create a form with multiple inputs. see www.data-shapes.net for tutorials and infos!

file_from_path = FileObject(path=multipleinputform.User_Inputs)

# group: Se obtiene información de los ejes del modelo
string = StringInput("Grid Lines")
importExcel = Data.ImportExcel(file=file_from_path, sheetName=string)
code_block_4 = CodeBlock { 2; }
dropItems = List.DropItems(list=importExcel, amount=code_block_4)
deconstruct = List.Deconstruct(list=dropItems)
transpose = List.Transpose(lists=deconstruct.rest)
code_block_5 = CodeBlock(l=transpose) { Direccion=l[1]; Nombre=l[2]; Distancia=l[3]; }
# note: Se extrae unidades de dimensiones
code_block_6 = CodeBlock(l=deconstruct.first) { Units=l[3]; }
# note: Se pasan unidades a metros
# (nodos personalizados)
pasarAMetros = Custom[PasarAMetros](Num=code_block_5.Distancia, Unt=code_block_6)  # package Filangas; Transforma unidades de variable a metros.

# group: Creación de ejes y niveles en Revit
string_2 = StringInput("X")
eq = code_block_5.Direccion == string_2
filterByBoolMask = List.FilterByBoolMask(list=code_block_5.Direccion, mask=eq)
string_3 = StringInput("Y")
eq_2 = filterByBoolMask.out == string_3
filterByBoolMask_2 = List.FilterByBoolMask(list=filterByBoolMask.out, mask=eq_2)
# note: Se pasan unidades a milímetros
convert_between_units = DynamoConvert(pasarAMetros, MeasurementType="Length", FromConversion="Meters", ToConversion="Millimeters")
# note: Separación por ejes X, Y y Z
filterByBoolMask_3 = List.FilterByBoolMask(list=convert_between_units, mask=eq)
filterByBoolMask_4 = List.FilterByBoolMask(list=filterByBoolMask_3.out, mask=eq_2)
minimumItem = List.MinimumItem(list=filterByBoolMask_4.in)
code_block_7 = CodeBlock(y=minimumItem) { y-1000; }
# note: Eje X
code_block_8 = CodeBlock { 0; }
byCoordinates = Point.ByCoordinates(x=filterByBoolMask_3.in, y=code_block_7, z=code_block_8)
YAxis = Vector.YAxis()
maximumItem = List.MaximumItem(list=filterByBoolMask_4.in)
code_block_9 = CodeBlock(x=maximumItem, y=code_block_7) { x-y+1000; }
byStartPointDirectionLength = Line.ByStartPointDirectionLength(startPoint=byCoordinates, direction=YAxis, length=code_block_9)
byLine = Grid.ByLine(line=byStartPointDirectionLength)
string_4 = StringInput("Name")
filterByBoolMask_5 = List.FilterByBoolMask(list=code_block_5.Nombre, mask=eq)
python_script = Python(IN[0]=filterByBoolMask_5.in)  # IronPython2
# ---------- python_script.python (18 lines) ----------
# Load the Python Standard and DesignScript Libraries
import sys
import clr
clr.AddReference('ProtoGeometry')
from Autodesk.DesignScript.Geometry import *

# The inputs to this node will be stored as a list in the IN variables.
dataEnteringNode = IN

Texto = []

for i in IN[0]:
	Texto.append(str(i))
	
# Place your code below this line

# Assign your output to the OUT variable.
OUT = Texto
# ----------------------------------------
setParameterByName = Element.SetParameterByName(element=byLine, parameterName=string_4, value=python_script)
minimumItem_2 = List.MinimumItem(list=filterByBoolMask_3.in)
code_block_10 = CodeBlock(x=minimumItem_2) { x-1000; }
# note: Eje Y
code_block_11 = CodeBlock { 0; }
byCoordinates_2 = Point.ByCoordinates(x=code_block_10, y=filterByBoolMask_4.in, z=code_block_11)
XAxis = Vector.XAxis()
maximumItem_2 = List.MaximumItem(list=filterByBoolMask_3.in)
code_block_12 = CodeBlock(b=maximumItem_2, a=code_block_10) { b-a+1000; }
byStartPointDirectionLength_2 = Line.ByStartPointDirectionLength(startPoint=byCoordinates_2, direction=XAxis, length=code_block_12)
byLine_2 = Grid.ByLine(line=byStartPointDirectionLength_2)
filterByBoolMask_6 = List.FilterByBoolMask(list=filterByBoolMask_5.out, mask=eq_2)
python_script_2 = Python(IN[0]=filterByBoolMask_6.in)  # IronPython2
# ---------- python_script_2.python (17 lines) ----------
# Load the Python Standard and DesignScript Libraries
import sys
import clr
clr.AddReference('ProtoGeometry')
from Autodesk.DesignScript.Geometry import *

# The inputs to this node will be stored as a list in the IN variables.
dataEnteringNode = IN

Texto = []

for i in IN[0]:
	Texto.append(str(i))
# Place your code below this line

# Assign your output to the OUT variable.
OUT = Texto
# ----------------------------------------
setParameterByName_2 = Element.SetParameterByName(element=byLine_2, parameterName=string_4, value=python_script_2)
python_script_3 = Python(IN[0]=filterByBoolMask_6.out)  # IronPython2; same code as python_script
# note: Eje Z
byElevationAndName = Level.ByElevationAndName(elevation=filterByBoolMask_4.out, name=python_script_3)
byLevel = StructuralPlanView.ByLevel(level=byElevationAndName)

# group: Se obtiene lista con ID de cada nodo con sus coordenadas x, y x
string_5 = StringInput("Joint Coordinates")
importExcel_2 = Data.ImportExcel(file=file_from_path, sheetName=string_5)
code_block_13 = CodeBlock { 2; }
dropItems_2 = List.DropItems(list=importExcel_2, amount=code_block_13)
deconstruct_2 = List.Deconstruct(list=dropItems_2)
transpose_2 = List.Transpose(lists=deconstruct_2.rest)
code_block_14 = CodeBlock(l=transpose_2) { NodoX=l[3]; NodoY=l[4]; NodoZ=l[5]; NodoID=l[0]; }

# note: Se extrae unidades de dimensiones
code_block_15 = CodeBlock(l=deconstruct_2.first) { Units=l[3]; }
# note: Se pasan unidades a metros
# (nodos personalizados)
pasarAMetros_2 = Custom[PasarAMetros](Num=code_block_14.NodoX, Unt=code_block_15)
# note: Se pasan unidades a milímetros
convert_between_units_2 = DynamoConvert(pasarAMetros_2, MeasurementType="Length", FromConversion="Meters", ToConversion="Millimeters")
pasarAMetros_3 = Custom[PasarAMetros](Num=code_block_14.NodoY, Unt=code_block_15)
convert_between_units_3 = DynamoConvert(pasarAMetros_3, MeasurementType="Length", FromConversion="Meters", ToConversion="Millimeters")
pasarAMetros_4 = Custom[PasarAMetros](Num=code_block_14.NodoZ, Unt=code_block_15)
convert_between_units_4 = DynamoConvert(pasarAMetros_4, MeasurementType="Length", FromConversion="Meters", ToConversion="Millimeters")
convierte_en_string = Python(IN[0]=code_block_14.NodoID)  # IronPython2
# ---------- convierte_en_string.python (21 lines) ----------
# Load the Python Standard and DesignScript Libraries
import sys
import clr
clr.AddReference('ProtoGeometry')
from Autodesk.DesignScript.Geometry import *

# The inputs to this node will be stored as a list in the IN variables.
dataEnteringNode = IN

# Place your code below this line

STR_List = []

for i in IN[0]:
	if isinstance(i, int) or isinstance(i, float):
		STR_List.append(str(int(round(i,0))))
	else:
		STR_List.append(i)

# Assign your output to the OUT variable.
OUT = STR_List
# ----------------------------------------

# group: Se obtiene lista con ID, nodo inicial y nodo final de cada elemento.
string_6 = StringInput("Connectivity - Frame")
importExcel_3 = Data.ImportExcel(file=file_from_path, sheetName=string_6)
code_block_16 = CodeBlock { 3; }
dropItems_3 = List.DropItems(list=importExcel_3, amount=code_block_16)
transpose_3 = List.Transpose(lists=dropItems_3)
code_block_17 = CodeBlock(l=transpose_3) { ElemID=l[0]; NodoIinicial=l[1]; NodoFinal=l[2]; LargoElem=l[4]; }

convierte_en_string_2 = Python(IN[0]=code_block_17.NodoIinicial)  # IronPython2; same code as convierte_en_string
convierte_en_string_3 = Python(IN[0]=code_block_17.NodoFinal)  # IronPython2; same code as convierte_en_string

# group: Creación de estructura en Dynamo
# note: Creación de Points
byCoordinates_3 = Point.ByCoordinates(x=convert_between_units_2, y=convert_between_units_3, z=convert_between_units_4)
punto_inicial = List.IndexOf(list=convierte_en_string, element=convierte_en_string_2)
getItemAtIndex = List.GetItemAtIndex(list=byCoordinates_3, index=punto_inicial)
punto_final = List.IndexOf(list=convierte_en_string, element=convierte_en_string_3)
getItemAtIndex_2 = List.GetItemAtIndex(list=byCoordinates_3, index=punto_final)
# note: Vector para obtener la dirección del elemento
byTwoPoints = Vector.ByTwoPoints(start=getItemAtIndex, end=getItemAtIndex_2)
byOriginNormal = Plane.ByOriginNormal(origin=getItemAtIndex, normal=byTwoPoints)
code_block_18 = CodeBlock { 200; }
# note: Creación de Profile (cuadrado)
byWidthLength = Rectangle.ByWidthLength(plane=byOriginNormal, width=code_block_18, length=code_block_18)
# note: Creación de Path
byStartPointEndPoint = Line.ByStartPointEndPoint(startPoint=getItemAtIndex, endPoint=getItemAtIndex_2)
# note: Se crean los elementos de sección cuadrada
bySweep = Solid.BySweep(profile=byWidthLength, path=byStartPointEndPoint)

categories = Categories("OST_GenericModel")
# note: Se crean elementos en Revit
byGeometry = DirectShape.ByGeometry(geometry=bySweep, category=categories, lacing=CrossProduct)

# group: Se obtiene ID de elemento con su sección
string_7 = StringInput("Frame Section Assignments")
importExcel_4 = Data.ImportExcel(file=file_from_path, sheetName=string_7)
code_block_19 = CodeBlock { 3; }
dropItems_4 = List.DropItems(list=importExcel_4, amount=code_block_19)
transpose_4 = List.Transpose(lists=dropItems_4)
code_block_20 = CodeBlock(l=transpose_4) { ElemID=l[0]; Seccion=l[3]; }

convierte_en_string_4 = Python(IN[0]=code_block_20.Seccion)  # IronPython2; same code as convierte_en_string

# group: Completa info de los elementos nuevos
string_8 = StringInput("Perfil")
setParameterByName_3 = Element.SetParameterByName(element=byGeometry, parameterName=string_8, value=convierte_en_string_4)

# group: Creación de parámetros de proyectos
code_block_21 = CodeBlock { "Perfil"; }
string_9 = StringInput("Text")
select_parameter_type = ParameterType("Text")
select_builtin_parameter_group = BuiltInParameterGroup("PG_TEXT")
boolean = BoolSelector(true)
createProjectParameter = Parameter.CreateProjectParameter(parameterName=code_block_21, groupName=string_9, type=select_parameter_type, group=select_builtin_parameter_group, instance=boolean, categoryList=categories)

# note: Se necesita que los parámetros de proyecto estén creados antes de asignarles un valor
passthrough = Custom[Passthrough](passThrough=setParameterByName_3, waitFor=createProjectParameter)  # package Clockwork for Dynamo 2.x; Forces a sequential order of execution. The node wired into the output of the Passthrough node will be executed *after* the node wired into the waitFor input (e.g. important for some Revit operations). The value of the passThrough input will be passed on to the node wired into the output port of the Passthrough node.
convierte_en_string_5 = Python(IN[0]=code_block_20.ElemID)  # IronPython2; same code as convierte_en_string
code_block_22 = CodeBlock { 0; }
getItemAtIndex_3 = List.GetItemAtIndex(list=multipleinputform.User_Inputs, index=code_block_22)
